# Grasshopper definition GHtoHoudini.ghx (Grasshopper 1.0.7)

field_size = Panel("1000")

field_size_2 = Panel("1000")
division = Division(A=field_size_2, B=2)
neg = Negative(Value=division)
dom = ConstructDomain(DomainStart=neg, DomainEnd=division)
rectangle = Rectangle(Plane=PlaneXY(0, 0, 0), XSize=dom, YSize=dom, Radius=0)  # -> Rectangle, Length

Z = UnitZ(Factor=1)
rec = Rectangle(rectangle.Rectangle)
pop2d = Populate2D(Region=rectangle.Rectangle, Count=Slider(30, range=0..100), Seed=1)
line = LineSDL(Start=pop2d, Direction=Z, Length=Slider(100, range=0..100))
end = EndPoints(Curve=line)  # -> Start, End

# ----
# import obj
panel = Panel("C:\Users\trtku\Data\git\myrepo\sand-report\data\obj\gh_to_houdini\ring2.obj")
path = FilePath(panel)
c_script = CSharpScript(file=path, import=Toggle(True), reset=Toggle(False))  # -> out, geometries; inputs file: String, import: Boolean, reset: Boolean
# ---------- c_script: C# usings ----------
using System.Linq;
using Rhino.DocObjects;
# ---------- c_script: C# ----------
    if(import){
      RhinoDoc.ActiveDoc.Objects.UnselectAll();
      string cmd = "!_-Import " + "\"" + file + "\"" + " _Enter";
      Rhino.RhinoApp.RunScript(cmd, false);
      var selectedObjs = RhinoDoc.ActiveDoc.Objects.GetSelectedObjects(false, false).ToList();
      geos = new List<GeometryBase>();
      foreach(RhinoObject selectedObj in selectedObjs){
        var geo = selectedObj.Geometry;
        geos.Add(geo);
        RhinoDoc.ActiveDoc.Objects.Delete(selectedObj, true);
      }
    }
    
    if(reset){
      geos.Clear();
    }
    

    geometries = geos;
# ---------- c_script: C# additional code ----------
  private List<GeometryBase> geos = new List<GeometryBase>();
# ---------- end c_script ----------
geo = Geometry(c_script.geometries)

geo_2 = Geometry([end.Start, end.End])
msphere = MeshSphere(Base=pop2d, Radius=10, UCount=10, VCount=20)
sph = Sphere(Base=pop2d, Radius=Slider(40, range=0..1000))
crv = Curve(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)
nurbs = NurbsCurve(Vertices=geo_2, Degree=3, Periodic=False)  # -> Curve, Length, Domain
tri = Triangulate(Mesh=msphere)  # -> Mesh, Count

# ----
# export iges
panel_2 = Panel("C:\Users\trtku\Data\git\myrepo\sand-report\data\iges\")
merge = Merge(Data1=line)
flatten = FlattenTree(Tree=merge, Path="{0}")
path_2 = FilePath(panel_2)

# ----
# transform
# XpYpZp in Rhino
# XpZnYp in Houdi
X = UnitX(Factor=1)
line_2 = LineSDL(Start=Point(0, 0, 0), Direction=X, Length=1)
rotax = RotateAxis(Angle=-1.570796327, Axis=line_2)  # -> Geometry, Transform
transform = Transform(Geometry=flatten, Transform=rotax.Transform)

c_script_2 = CSharpScript(geometries=transform, filename="lines_transformed.iges", directory=path_2, export=Toggle(False))  # inputs geometries: tree of GeometryBase, filename: String, directory: String, export: Boolean
# ---------- c_script_2: C# usings ----------
using System.IO;
# ---------- c_script_2: C# ----------
    if(export){

      var guids = new List<Guid>();

      for(int i = 0; i < geometries.BranchCount; i++){
        for(int n = 0; n < geometries.Branches[i].Count; n++){
          var geom = geometries.Branches[i][n];
          var guid = Rhino.RhinoDoc.ActiveDoc.Objects.Add(geom);
          guids.Add(guid);
        }
      }

      Rhino.RhinoDoc.ActiveDoc.Objects.Select(guids);

      string filepath = Path.Combine(directory, filename);
      string cmd = "_-Export " + "\"" + filepath + "\"" + " _Enter _Enter";

      Rhino.RhinoApp.RunScript(cmd, false);

      Rhino.RhinoDoc.ActiveDoc.Objects.Delete(guids, true);
    }
# ---------- end c_script_2 ----------
