# Grasshopper definition kuka_prc_test.ghx (Grasshopper 1.0.7)
# plug-ins: KUKA|prc - parametric robot control

# ----
# General
# Setting
number_slider = Slider(1, range=0..1)
initial_vel_m_sec = Panel("0.01")
kr6_10_r1100_2 = AgilusKR610R11002Robot(infiniterot=False)
filename = Panel("test")
save = BooleanToggle(False)

# ----
# Scene
# Planning
mesh = Mesh([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])
mesh_2 = Mesh(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)
mesh_3 = Mesh(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)

panel = Panel("""&ACCESS RVP
&REL 1
&PARAM TEMPLATE = C:\KRC\Roboter\Template\vorgabe
&PARAM EDITMASK = *
DEF test ( )


;FOLD INI
;FOLD BASISTECH INI
GLOBAL INTERRUPT DECL 3 WHEN $STOPMESS==TRUE DO IR_STOPM ( )
INTERRUPT ON 3
BAS (#INITMOV,0 )
;ENDFOLD (BASISTECH INI)
;ENDFOLD (INI)

;FOLD STARTPOSITION - BASE IS 0, TOOL IS 0, SPEED IS 15%, POSITION IS A1 0,A2 -90,A3 90,A4 0,A5 0,A6 0,E1 0,E2 0,E3 0,E4 0
$BWDSTART = FALSE
PDAT_ACT = {VEL 15,ACC 100,APO_DIST 50}
FDAT_ACT = {TOOL_NO 0,BASE_NO 0,IPO_FRAME #BASE}
BAS (#PTP_PARAMS,15)
PTP  {A1 0,A2 -90,A3 90,A4 0,A5 0,A6 0,E1 0,E2 0,E3 0,E4 0}
;ENDFOLD

;FOLD LIN SPEED IS 0.25 m/sec, INTERPOLATION SETTINGS IN FOLD
$VEL.CP=0.25
$ADVANCE=3
;ENDFOLD

PTP {X 500, Y 0, Z 500, A -180, B 0, C 180, E1 0, E2 0, E3 0, E4 0, S 'B 010'} C_PTP
LIN {X 500, Y 0, Z 500, A -180, B 0, C 180, E1 0, E2 0, E3 0, E4 0} C_DIS
HALT

END""")
python = GhPythonScript(run=Toggle(False))  # -> out, a; inputs run: Boolean
# ---------- python: Python ----------
import socket
import traceback

def read(HOST='172.31.1.147', PORT=30003):
    """
    Method that opens a TCP socket to the robot, receives data from the robot server and then closes socket

    Returns:
        data: Data broadcast by the robot. In bytes
    """

    s = socket.socket(socket.AF_INET, socket.SOCK_STREAM)
    s.settimeout(1)
    
    try:
        s.connect((HOST, PORT))
        print "connected"
    except:
        traceback.print_exc()
        print "Cannot connect to ",HOST,PORT
    
#    s.settimeout(None)
#    data = s.recv(1024)
    s.close()
    return data

if run:
    read()
# ---------- end python ----------
sender = GhPythonScript(script=panel, execute=Toggle(False))  # -> out, a
# ---------- sender: Python ----------
__author__  = 'petrus'
__version__ = '2021.10.04'


import socket                   # module for network comunication

robot_ip = '172.31.1.147'      # numerical label assigned to the UR robotic arm


def send_script(ur_ip, script):
#    socket.create_connection(
    s = socket.create_connection(ur_ip) 
    #creates a connection between this computer and the robot. This computer must have an ip number that is the same except for the last two numbers.
    s.send(script)
    print ("Script sent to %s on port %i" % (ur_ip))
    s.close()


if execute:
    
    send_script(robot_ip,script)
# ---------- end sender ----------
path = DataPath("{0}")
path_2 = DataPath("{1}")

# ----
# Tool
# Settings
tool_height = Panel("555")
tool_mound_radius = Panel("40")
mesh_4 = Mesh(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)
int = Integer(0)
xy = XYPlane(Origin=Point(0, 0, 0))
custom_tool_pln = CustomToolPlaneKUKAPrc(ToolGeometry=mesh_4, ToolNumber=int, ToolPlane=xy, frameinput=False)

# ----
# Initial
# Plane
number_slider_2 = Slider(633, range=-1000..1000)
x_angle = Slider(0, range=-180..180)
y_angle = Slider(0, range=-180..180)
z_angle = Slider(0, range=-180..180)
pt = ConstructPoint(XCoordinate=number_slider_2, YCoordinate=Slider(0, range=-1000..1000), ZCoordinate=Slider(1000, range=-1000..1000))
rad = Radians(Degrees=x_angle)
rad_2 = Radians(Degrees=y_angle)
rad_3 = Radians(Degrees=z_angle)
X = UnitX(Factor=1)
Y = UnitY(Factor=1)
pl = ConstructPlane(Origin=pt, XAxis=expr("-x", X), YAxis=Y)
deplane = DeconstructPlane(Plane=pl)  # -> Origin, XAxis, YAxis, ZAxis
subtraction = Subtraction(A=tool_height, B=tool_mound_radius)
rot3d = Rotate3D(Geometry=pl, Angle=rad, Center=deplane.Origin, Axis=deplane.XAxis)  # -> Geometry, Transform
deplane_2 = DeconstructPlane(Plane=rot3d.Geometry)  # -> Origin, XAxis, YAxis, ZAxis
rot3d_2 = Rotate3D(Geometry=rot3d.Geometry, Angle=rad_2, Center=deplane_2.Origin, Axis=deplane_2.YAxis)  # -> Geometry, Transform
deplane_3 = DeconstructPlane(Plane=rot3d_2.Geometry)  # -> Origin, XAxis, YAxis, ZAxis
rot3d_3 = Rotate3D(Geometry=rot3d_2.Geometry, Angle=rad_3, Center=deplane_3.Origin, Axis=deplane_3.ZAxis)  # -> Geometry, Transform
deplane_4 = DeconstructPlane(Plane=rot3d_3.Geometry)  # -> Origin, XAxis, YAxis, ZAxis
multiplication = Multiplication(A=deplane_4.ZAxis, B=subtraction)
move = Move(Geometry=rot3d_3.Geometry, Motion=multiplication)  # -> Geometry, Transform
deplane_5 = DeconstructPlane(Plane=move.Geometry)  # -> Origin, XAxis, YAxis, ZAxis
data = Data(deplane_5.Origin)
pln = Plane(rot3d_3.Geometry)

tool_bottom_plane = Panel(data)

# ----
# Target
# Plane01
pt_2 = Point(Point(360, -375, -244))
vel_to_ths_plane_m_sec = Panel("0.01")
rad_4 = Radians(Degrees=Slider(-45, range=-180..180))
pdecon = Deconstruct(Point=pt_2)  # -> XComponent, YComponent, ZComponent
pl_2 = ConstructPlane(Origin=pt_2, XAxis=Vector(1, 0, 0), YAxis=Vector(0, 1, 0))
pflip = FlipPlane(Plane=pl_2, ReverseX=False, ReverseY=False, SwapAxes=True)
rotate = Rotate(Geometry=pflip, Angle=rad_4, Plane=pflip)  # -> Geometry, Transform
subtraction_2 = Subtraction(A=tool_height, B=tool_mound_radius)
Z = UnitZ(Factor=subtraction_2)
move_2 = Move(Geometry=rotate.Geometry, Motion=Z)  # -> Geometry, Transform
pln_2 = Plane(move_2.Geometry)
num = Number(vel_to_ths_plane_m_sec)

# ----
# Approach
# Plane
pln_3 = Plane(move_2.Geometry)
safe_distance = Slider(400, range=0..1000)
vel_to_ths_plane_m_sec_2 = Panel("0.01")
Z_2 = UnitZ(Factor=safe_distance)
move_3 = Move(Geometry=pln_3, Motion=Z_2)  # -> Geometry, Transform
pln_4 = Plane(move_3.Geometry)
num_2 = Number(vel_to_ths_plane_m_sec_2)

# ----
# Target
# Plane02
pln_5 = Plane(move_2.Geometry)
vel_to_ths_plane_m_sec_3 = Panel("0.001")
Z_3 = UnitZ(Factor=Slider(100, range=0..100))
move_4 = Move(Geometry=pln_5, Motion=Z_3)  # -> Geometry, Transform
pln_6 = Plane(move_4.Geometry)
num_3 = Number(vel_to_ths_plane_m_sec_3)

merge = Merge(Data1=mesh, Data2=mesh_2, Data3=mesh_3, Data4=mesh_4)
merge_2 = Merge(Data1=pln, Data2=initial_vel_m_sec)  # -> graft(Result)
merge_3 = Merge(Data1=pln_4, Data2=num_2)  # -> graft(Result)
merge_4 = Merge(Data1=pln_2, Data2=num)  # -> graft(Result)
merge_5 = Merge(Data1=pln_6, Data2=num_3)  # -> graft(Result)
merge_6 = Merge(Data1=merge_2, Data2=merge_3, Data3=merge_4, Data4=merge_5)  # -> simplify(Result)
panel_2 = Panel(merge_6)
branch = TreeBranch(Tree=merge_6, Path=path, MaintainPaths=True)
branch_2 = TreeBranch(Tree=merge_6, Path=path_2, MaintainPaths=True)
lin_move = LINearMovementKUKAPrc(TargetAsPlane=branch, Speed=branch_2, extaxenabled=False)
kuka_prc = KUKAPrcCORE(
    SimulationSlider=number_slider,
    KUKAPrcCommands=lin_move,
    Tool=custom_tool_pln,
    Robot=kr6_10_r1100_2,
    CollisionGeometry=merge,
    SaveToggle=save,
    Filename=filename,
    PRC_BaseExpose=False,
    PRC_SaveNameExpose=True,
    PRCsettings="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")  # -> RobotGeometry, AnalysisOutput
