# Grasshopper definition pavilion_model.ghx (Grasshopper 1.0.7)
# plug-ins: Kangaroo2 Components, Weaverbird, NGon

number_slider = Slider(350, range=0..1000)
xy = XYPlane(Origin=Point(0, 0, 0))
sqrt = SquareRoot(Value="2")
division = Division(A=number_slider, B=sqrt)
rectangle = Rectangle(Plane=xy, XSize=number_slider, YSize=division, Radius=0)  # -> Rectangle, Length

xy_2 = XYPlane(Origin=Point(0, 0, 0))
number_slider_2 = Slider(1800, range=0..10000)
number_slider_3 = Slider(6, range=0..10)
rectangle_2 = Rectangle(Plane=xy_2, XSize=number_slider_2, YSize=number_slider_2, Radius=0)  # -> Rectangle, Length

division_2 = Division(A=Slider(420, range=0..1000), B=2)
division_3 = Division(A=Slider(295, range=0..1000), B=2)
neg = Negative(Value=division_2)
neg_2 = Negative(Value=division_3)
area = Area(Geometry=rectangle.Rectangle)  # -> Area, Centroid
dom = ConstructDomain(DomainStart=neg_2, DomainEnd=division_3)
dom_2 = ConstructDomain(DomainStart=neg, DomainEnd=division_2)
rectangle_3 = Rectangle(Plane=area.Centroid, XSize=dom_2, YSize=dom, Radius=0)  # -> Rectangle, Length

offset = OffsetCurve(Curve=rectangle_2.Rectangle, Distance=expr("-x", Slider(300, range=0..1000)), Corners=1)
pop2d = Populate2D(Region=offset, Count=number_slider_3, Seed=Slider(6, range=1..10))
pop2d_2 = Populate2D(Region=rectangle.Rectangle, Count=Slider(16, range=1..30), Seed=1)
voronoi = Voronoi(Points=pop2d, Boundary=rectangle_2.Rectangle, Plane=xy_2, BruteForceOverride=False)
xy_3 = XYPlane(Origin=pop2d)
mergin = Slider(2, range=0..100)
voronoi_2 = Voronoi(Points=pop2d_2, Boundary=rectangle.Rectangle, Plane=xy, BruteForceOverride=False)

area_2 = Area(Geometry=voronoi_2)  # -> Area, Centroid
crv_cp = CurveClosestPoint(Point=area_2.Centroid, Curve=voronoi_2)  # -> Point, Parameter, Distance
dist = Distance(PointA=area_2.Centroid, PointB=crv_cp.Point)
sort = SortList(Keys=dist)  # -> Keys, ValuesA
item = ListItem(List=sort.Keys, Index=0, Wrap=True)
rad = Radians(Degrees="32")
tan = Tangent(Value=rad)
multiplication = Multiplication(A=item, B=tan)

offset_2 = OffsetCurve(Curve=voronoi_2, Distance=expr("-x", mergin), Plane=xy_3, Corners=0)  # -> flatten(Curve)
random = Random(Range=Domain(0, 1), Number=number_slider_3, Seed=2)
dom_3 = ConstructDomain(DomainStart=Slider(2000, range=0..10000), DomainEnd=Slider(2000, range=0..10000))

Z = UnitZ(Factor=multiplication)
neg_3 = Negative(Value=Z)
move = Move(Geometry=rectangle_3.Rectangle, Motion=neg_3)  # -> Geometry, Transform
boundary = BoundarySurfaces(Edges=move.Geometry)
Z_2 = UnitZ(Factor=Slider(4, range=0..10))
neg_4 = Negative(Value=Z_2)
extr = Extrude(Base=boundary, Direction=neg_4)

explode = Explode(Curve=rectangle_3.Rectangle, Recursive=True)  # -> Segments, Vertices
divide = DivideCurve(Curve=explode.Segments, Count=Slider(3, range=0..10), Kinks=False)  # -> Points, Tangents, Parameters
item_2 = ListItem(List=divide.Points, Index=0, Wrap=True)  # -> Item, Item1, Item2
merge = Merge(Data1=item_2.Item1, Data2=item_2.Item2)
offset_3 = OffsetCurve(Curve=rectangle.Rectangle, Distance=Slider(2.5, range=0..10), Corners=1)
crv_cp_2 = CurveClosestPoint(Point=merge, Curve=offset_3)  # -> Point, Parameter, Distance
ln = Line(StartPoint=merge, EndPoint=crv_cp_2.Point)

remap = RemapNumbers(Value=random, Source=Domain(0, 1), Target=dom_3)  # -> Mapped, Clipped
number_slider_4 = Slider(3, range=0..100)
number_slider_5 = Slider(30, range=0..1000)
area_3 = Area(Geometry=offset_2)  # -> Area, Centroid
cir = Circle(Plane=area_3.Centroid, Radius=number_slider_4)
multiplication_2 = Multiplication(A=number_slider_4, B=Slider(1.2, range=1..2))
division_4 = Division(A=multiplication, B=Slider(3, range=0..10))
Z_3 = UnitZ(Factor=Slider(10, range=0..100))
offset_4 = OffsetCurve(Curve=cir, Distance=multiplication_2, Corners=1)
Z_4 = UnitZ(Factor=division_4)
Z_5 = UnitZ(Factor=multiplication)
extr_2 = Extrude(Base=offset_2, Direction=Z_3)
neg_5 = Negative(Value=Z_4)
neg_6 = Negative(Value=Z_5)
cap = CapHoles(Brep=extr_2)
Z_6 = UnitZ(Factor=remap.Mapped)
move_2 = Move(Geometry=cir, Motion=neg_6)  # -> Geometry, Transform
move_3 = Move(Geometry=offset_4, Motion=neg_5)  # -> Geometry, Transform
move_4 = Move(Geometry=cap, Motion=Z_6)  # -> Geometry, Transform
volume = Volume(Geometry=move_4.Geometry)  # -> Volume, Centroid
merge_2 = Merge(Data1=simplify(graft(offset_2)), Data2=simplify(move_3.Geometry))
merge_3 = Merge(Data1=simplify(move_3.Geometry), Data2=simplify(graft(move_2.Geometry)))
loft_opt = LoftOptions(Closed=False, Adjust=True, Rebuild=0, Refit=0, Type=0)
loft = Loft(Curves=merge_2, Options=loft_opt)
loft_2 = Loft(Curves=merge_3, Options={Adjust=False, Closed=False, LoftEnds=0, LoftSimp=0, LoftType=0, Rebuild=10, Refit=0.01})
merge_4 = Merge(Data1=loft, Data2=loft_2)
join = BrepJoin(Breps=merge_4)  # -> Breps, Closed
mesh = MeshBrep(
    Brep=join.Breps,
    Settings={GridMaxCount=0, GridMinCount=16, JaggedSeams=False, MaxEdgeLength=0, MinEdgeLength=0.0001, MinTolerance=0, Refine=True, RefineAngle=0, RelativeTolerance=0.65, SimplePlanes=True, Tolerance=0})
triremesh = TriRemesh(Geometry=mesh, Length=Slider(3, range=0..10), Iterations=Slider(25, range=0..100))  # -> Triangulation, Dual, Creases
nv = NakedVertices(Mesh=triremesh.Triangulation)  # -> ClothedIndex, NakedIndex, ClothedPts, NakedPts
medges = MeshEdges(Mesh=triremesh.Triangulation)  # -> NakedEdges, InteriorEdges, NonManifoldEdges
merge_5 = Merge(Data1=medges.NakedEdges, Data2=medges.InteriorEdges)
pt = Point(nv.NakedPts)
anchor = Anchor(Point=pt, Target=pt, Strength=Slider(100000, range=0..100000))
show = Show(G=triremesh.Triangulation)
length_line = LengthLine(Line=merge_5, Length=Slider(0, range=0..100), Strength=Slider(100, range=0..10000))
entwine = Entwine(Branch00=[anchor, length_line], Branch01=show, FlattenInputs=True)
solver = Solver(GoalObjects=entwine, Reset=Button(), Threshold=1e-15, Tolerance=0.0001, On=Toggle(False))  # -> I, V, O
branch = TreeBranch(Tree=simplify(solver.O), Path="{1}", MaintainPaths=True)
number_slider_6 = Slider(5, range=0..100)

merge_6 = Merge(Data1=rectangle.Rectangle, Data2=offset_3)
project = Project(Curve=merge_6, Brep=boundary, Direction=Vector(0, 0, 1))
addition = Addition(A=multiplication, B=number_slider_6)
Z_7 = UnitZ(Factor=addition)
flatten = FlattenTree(Tree=project, Path="{0}")
loft_3 = Loft(Curves=flatten, Options={Adjust=False, Closed=False, LoftEnds=0, LoftSimp=0, LoftType=0, Rebuild=10, Refit=0.01})
extr_3 = Extrude(Base=loft_3, Direction=Z_7)

dam = DataDam(DataA=branch, BufferDelay=10000000, BufferMode=0)
offsetmesh = OffsetMesh(Mesh=dam, Dist=number_slider_6, Solid=True)
wbnaked = WeaverbirdsNakedBoundary(MeshClosedPolylines=graft(dam))
subtraction = Subtraction(A=Slider(100, range=0..10000), B=multiplication)
tri = Triangulate(Mesh=offsetmesh)  # -> Mesh, Count
item_3 = ListItem(List=wbnaked, Index=0, Wrap=True)  # -> Item, Item1
Z_8 = UnitZ(Factor=subtraction)
neg_7 = Negative(Value=Z_8)
extr_4 = Extrude(Base=item_3.Item1, Direction=neg_7)
number_slider_7 = Slider(10, range=0..100)
mesh_2 = MeshBrep(
    Brep=extr_4,
    Settings={GridMaxCount=0, GridMinCount=16, JaggedSeams=False, MaxEdgeLength=0, MinEdgeLength=0.0001, MinTolerance=0, Refine=True, RefineAngle=0, RelativeTolerance=0.65, SimplePlanes=True, Tolerance=0})
m_caps = MeshCaps(M=mesh_2, W=True, O=True, D=0)  # -> out, A, E; inputs M: Mesh, clr: Color
# ---------- m_caps: VB ----------
    Component.Params.Input(0).Name = "Mesh"
    Component.Params.Input(0).Description = "An open mesh"
    Component.Params.Input(1).Name = "Join and Weld"
    Component.Params.Input(1).Description = "If true the original mesh will be joined and welded to the new caps, else the caps will be output as a list of new meshes"
    Component.Params.Input(2).Name = "Simplify Faces"
    Component.Params.Input(2).Description = "If true, naked edges consisting of 3 to 4 segments will be replaced with a single face, else faces will use new center vertex method"
    Component.Params.Input(3).Name = "Distance (Optional, Rhino Units)"
    Component.Params.Input(3).Description = "A single number which sets the Rhino unit based distance that the center point will be offset from the vertex averages"

    Component.Params.Output(1).Name = "Mesh"
    Component.Params.Output(1).Description = "If successful, a list or single of valid meshes"
    Component.Params.Output(2).Name = "Polylines"
    Component.Params.Output(2).Description = "If successful, a list of valid edge polylines"

    If M IsNot Nothing Then
      Dim i,j,k,kk,ka As Integer
      Dim arrP() As polyline
      Dim P As polyline
      Dim arrM As New list(Of Mesh)
      Dim mj As New mesh
      Dim clrB,clrC,blnN() As Boolean
      Dim oc,tcc As New list(Of color)
      If (clr <> Nothing) Then clrC = True
      If ((m.VertexColors.count() > 0) Or (clr <> Nothing)) Then clrB = True
      If (m.VertexColors.count() = 0) Then  m.vertexcolors.CreateMonotoneMesh(color.LightGray)
      oc = m.VertexColors.ToArray.tolist()
      Dim mv() As point3d
      Dim mo As New list(Of mesh)
      Dim fc As New list(Of MeshFace)
      Dim np As New list(Of point3d)
      Dim ni As New list(Of Integer)
      Dim ind(3) As Integer

      mv = m.Vertices.ToPoint3dArray()
      blnN = m.GetNakedEdgePointStatus()
      arrP = m.GetNakedEdges()

      For i = 0 To ubound(blnN) Step 1
        If blnN(i) Then
          np.add(mv(i))
          ni.add(i)
        End If
      Next

      Dim cld As New pointcloud(np.toarray())
      For i = 0 To ubound(arrP) Step 1
        Dim tm As New mesh
        tm.Vertices.Clear()
        tm.Faces.Clear()

        p = arrP(i)
        If (O And (p.count() < 6)) Then
          ind(0) = ni(cld.ClosestPoint(p(0)))
          ind(1) = ni(cld.ClosestPoint(p(1)))
          ind(2) = ni(cld.ClosestPoint(p(2)))
          ind(3) = ni(cld.ClosestPoint(p(3)))
          tm.Vertices.Add(mv(ind(0)))
          tm.Vertices.Add(mv(ind(1)))
          tm.Vertices.Add(mv(ind(2)))

          tm.VertexColors.Add(oc(ind(0)))
          tm.VertexColors.Add(oc(ind(1)))
          tm.VertexColors.Add(oc(ind(2)))
          If p.count() = 5 Then
            fc.add(New meshface(ind(0), ind(1), ind(2), ind(3)))
            tm.Vertices.Add(mv(ind(3)))
            tm.VertexColors.Add(oc(ind(3)))
            tm.Faces.addface(New meshface(0, 1, 2, 3))
          ElseIf p.count() = 4 Then
            fc.add(New meshface(ind(0), ind(1), ind(2)))
            tm.Faces.addface(New meshface(0, 1, 2))
          End If
          tm.FaceNormals.ComputeFaceNormals()
          tm.Normals.ComputeNormals()
          mo.add(tm)

        Else
          Dim tx As New mesh
          Dim vec As New vector3d
          Dim tv As New list(Of point3d)
          Dim tc As New list(Of color)
          Dim tfc As New list(Of meshface)
          Dim r,g,b As Integer
          Dim tcl As color
          k = cld.ClosestPoint(p(0))
          ka = k
          tx.Vertices.AddVertices(p.ToArray())
          tx.Faces.AddFaces(p.TriangulateClosedPolyline())
          tx.Normals.ComputeNormals()

          vec = tx.Normals(0)

          tv.add(p(0))
          tc.add(oc(k))
          r = oc(ni(k)).R
          g = oc(ni(k)).G
          b = oc(ni(k)).B
          For j = 1 To p.count() - 2 Step 1
            kk = cld.ClosestPoint(p(j))
            fc.add(New meshface(m.Vertices.count(), ni(k), ni(kk)))
            vec += tx.Normals(j)
            k = kk

            tv.add(p(j))
            tc.add(oc(k))
            r += oc(ni(k)).R
            g += oc(ni(k)).G
            b += oc(ni(k)).B
            tfc.add(New meshface(p.count() - 1, j - 1, j))
          Next
          fc.add(New meshface(m.Vertices.count(), ni(k), ni(ka)))
          vec.Unitize()
          vec *= D
          m.Vertices.add(p.CenterPoint() + vec)

          r /= (p.count() - 1)
          g /= (p.count() - 1)
          b /= (p.count() - 1)
          If r > 255 Then r = 255 Else If r < 0 Then r = 0
          If g > 255 Then g = 255 Else If g < 0 Then g = 0
          If b > 255 Then b = 255 Else If b < 0 Then b = 0
          If clrC Then tcl = clr Else tcl = color.FromArgb(r, g, b)
          m.VertexColors.Add(tcl)

          tv.add(p.CenterPoint() + vec)
          tc.add(tcl)
          tfc.add(New meshface(p.count() - 1, p.count() - 2, 0))
          tm.vertices.AddVertices(tv.toarray())
          If clrB Then tm.VertexColors.AppendColors(tc.toarray())
          tm.faces.addfaces(tfc)
          tm.FaceNormals.ComputeFaceNormals()
          tm.Normals.ComputeNormals()
          mo.add(tm)
        End If
      Next

      If w Then
        m.Faces.AddFaces(fc)
        m.FaceNormals.ComputeFaceNormals()
        m.UnifyNormals()
        m.Normals.ComputeNormals()
        If Not clrB Then m.VertexColors.Clear()
        A = m
      Else
        A = mo
      End If
      E = arrP
    End If
# ---------- m_caps: VB additional code ----------
  Private Function avgC(ByVal R As Double, ByVal G As Double, ByVal B As Double, ByVal T As Integer)

    R /= t
    G /= t
    B /= t
    If R > 255 Then R = 255 Else If R < 0 Then R = 0
    If G > 255 Then G = 255 Else If G < 0 Then G = 0
    If B > 255 Then B = 255 Else If B < 0 Then B = 0

    Return color.FromArgb(CInt(R), CInt(G), CInt(B))
  End Function
# ---------- end m_caps ----------
tri_2 = Triangulate(Mesh=m_caps.A)  # -> Mesh, Count
division_5 = Division(A=number_slider_6, B="2")
Z_9 = UnitZ(Factor=division_5)

explode_2 = Explode(Curve=voronoi_2, Recursive=True)  # -> Segments, Vertices
dupln = RemoveDuplicateLines(Lines=explode_2.Segments, Tolerance=0.01)
end = EndPoints(Curve=dupln)  # -> Start, End
vec = Vector(dupln)
unit = UnitVector(Vector=vec)
multiplication_3 = Multiplication(A=unit, B=Slider(50, range=0..100))
Z_10 = UnitZ(Factor=1)
xprod = CrossProduct(VectorA=unit, VectorB=Z_10, Unitize=False)  # -> Vector, Length
neg_8 = Negative(Value=xprod.Vector)

midpt = CurveMiddle(Curve=dupln)

move_5 = Move(Geometry=midpt, Motion=multiplication_3)  # -> Geometry, Transform
line = LineSDL(Start=midpt, Direction=xprod.Vector, Length=mergin)
line_2 = LineSDL(Start=midpt, Direction=neg_8, Length=mergin)
merge_7 = Merge(Data1=line, Data2=line_2)
join_2 = JoinCurves(Curves=merge_7, Preserve=False)
ext = ExtendCurve(Curve=join_2, Type=0, Start=number_slider_7, End=number_slider_7)
meshpipe = MeshPipe(Curve=ext, Radius=Slider(0.5, range=0..100), Sides=6, Tolerance=10, Ending=3)

move_6 = Move(Geometry=meshpipe, Motion=Z_9)  # -> Geometry, Transform
merge_8 = Merge(Data1=move_6.Geometry, Data2=tri.Mesh, Data3=tri_2.Mesh)  # -> flatten(Result)
munion = MeshUnion(Meshes=merge_8)
